# Grasshopper definition bugtest.ghx (Grasshopper 1.0.8)

xy = XYPlane(Origin=Point(0, 0, 0))
rad = Radians(Degrees=Slider(20, range=0..100))
rad_2 = Radians(Degrees=Slider(20, range=0..100))
X = UnitX(Factor=1)
Y = UnitY(Factor=1)
rot3d = Rotate3D(Geometry=xy, Angle=rad, Center=Point(0, 0, 0), Axis=X)  # -> Geometry, Transform
rot3d_2 = Rotate3D(Geometry=rot3d.Geometry, Angle=rad_2, Center=Point(0, 0, 0), Axis=Y)  # -> Geometry, Transform
geo = Geometry(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)
bbox = BoundingBox(Content=geo, Plane=rot3d_2.Geometry)  # -> Box, Box_2
volume = Volume(Geometry=bbox.Box)  # -> Volume, Centroid
number_slider = Slider(16, range=5..30)
scale = Scale(Geometry=bbox.Box, Center=volume.Centroid, Factor=Slider(0.95, range=0..1))  # -> Geometry, Transform
debrep = DeconstructBrep(Brep=scale.Geometry)  # -> Faces, Edges, Vertices
# Edges along Plane.X and Plane.Y
item = ListItem(List=debrep.Edges, Index=0, Wrap=True)  # -> Item, Item1
deplane = DeconstructPlane(Plane=rot3d_2.Geometry)  # -> Origin, XAxis, YAxis, ZAxis
pframes = PerpFrames(Curve=item.Item, Count=number_slider, Align=True)  # -> Frames, Parameters
pframes_2 = PerpFrames(Curve=item.Item1, Count=number_slider, Align=True)  # -> Frames, Parameters
sec = BrepPlane(Brep=geo, Plane=pframes.Frames)  # -> Curves, Points
# Section along Edges[0]
boundary = BoundarySurfaces(Edges=sec.Curves)  # -> simplify(Surfaces)
sec_2 = BrepPlane(Brep=geo, Plane=pframes_2.Frames)  # -> Curves, Points
# Section along Edges[1]
boundary_2 = BoundarySurfaces(Edges=sec_2.Curves)  # -> simplify(Surfaces)
debrep_2 = DeconstructBrep(Brep=bbox.Box)  # -> Faces, Edges, Vertices
item_2 = ListItem(List=debrep_2.Edges, Index=Slider(8, range=0..10), Wrap=True)
len = Length(Curve=item_2)
graft = GraftTree(Tree=pframes.Frames, IncludeEmptyLists=True, IncludeNullItems=True)  # -> simplify(Tree)
graft_2 = GraftTree(Tree=pframes_2.Frames, IncludeEmptyLists=True, IncludeNullItems=True)  # -> simplify(Tree)
graft_3 = GraftTree(Tree=boundary, IncludeEmptyLists=True, IncludeNullItems=True)
flatten = FlattenTree(Tree=boundary, Path="{0}")
graft_4 = GraftTree(Tree=boundary_2, IncludeEmptyLists=True, IncludeNullItems=True)
flatten_2 = FlattenTree(Tree=boundary_2, Path="{0}")
c_script = CSharpScript(x=graft, y=graft_3)  # -> out, a; inputs x: tree, y: tree
# ---------- c_script: C# ----------
// Grasshopper Script Instance
#region Usings
using System;
using System.Linq;
using System.Collections;
using System.Collections.Generic;
using System.Drawing;

using Rhino;
using Rhino.Geometry;

using Grasshopper;
using Grasshopper.Kernel;
using Grasshopper.Kernel.Data;
using Grasshopper.Kernel.Types;
#endregion

public class Script_Instance : GH_ScriptInstance
{
    #region Notes
    /* 
      Members:
        RhinoDoc RhinoDocument
        GH_Document GrasshopperDocument
        IGH_Component Component
        int Iteration

      Methods (Virtual & overridable):
        Print(string text)
        Print(string format, params object[] args)
        Reflect(object obj)
        Reflect(object obj, string method_name)
    */
    #endregion

    private void RunScript(DataTree<object> x, DataTree<object> y, ref object a)
    {
        var xMap = new Dictionary<int, object>();
        foreach (GH_Path p in x.Paths){
            var branch = x.Branch(p);
            if (branch.Count > 0){
                xMap[p.Indices[0]] = branch[0];
            }
        }

        var result = new DataTree<object>();
        foreach (GH_Path p in y.Paths){
            int n = p.Indices[0];
            if (xMap.TryGetValue(n, out object item)){
                result.Add(item, p);
            }
        }

        a = result;
    }
}
# ---------- end c_script ----------
c_script_2 = CSharpScript(x=graft_2, y=graft_4)  # -> out, a; inputs x: tree, y: tree; same code as c_script
bbx = BrepBrep(BrepA=graft_3, BrepB=flatten_2)  # -> Curves, Points
material_thickness = Slider(3.1, range=0..10)
yz = YZPlane(Origin=Point(0, 0, 0))
xy_2 = XYPlane(Origin=Point(0, 0, 0))
bbx_2 = BrepBrep(BrepA=graft_4, BrepB=flatten)  # -> Curves, Points
pshift = ShiftPaths(Data=bbx_2.Curves, Offset=-1)
midpt = CurveMiddle(Curve=pshift)
pshift_2 = ShiftPaths(Data=bbx.Curves, Offset=-1)
midpt_2 = CurveMiddle(Curve=pshift_2)
line = LineSDL(Start=midpt, Direction=expr("-x", deplane.ZAxis), Length=len)
line_2 = LineSDL(Start=midpt_2, Direction=deplane.ZAxis, Length=len)
deplane_2 = DeconstructPlane(Plane=rot3d_2.Geometry)  # -> Origin, XAxis, YAxis, ZAxis
deplane_3 = DeconstructPlane(Plane=rot3d_2.Geometry)  # -> Origin, XAxis, YAxis, ZAxis
pipe = Pipe(Curve=line, Radius=expr("x/2", material_thickness), Caps=1, FitRail=False)
pipe_2 = Pipe(Curve=line_2, Radius=expr("x/2", material_thickness), Caps=1, FitRail=False)
pshift_3 = ShiftPaths(Data=pipe, Offset=-1)
pshift_4 = ShiftPaths(Data=pipe_2, Offset=-1)
sec_3 = BrepPlane(Brep=pshift_3, Plane=c_script_2.a)  # -> Curves, Points
pshift_5 = ShiftPaths(Data=sec_3.Curves, Offset=-1)
rdiff = RegionDifference(CurvesA=graft_4, CurvesB=pshift_5)
rdiff_2 = RegionDifference(CurvesA=graft_4, CurvesB=pshift_5)
area = Area(Geometry=rdiff)  # -> Area, Centroid
pl = ConstructPlane(Origin=area.Centroid, XAxis=deplane_2.ZAxis, YAxis=deplane_2.XAxis)
sec_4 = BrepPlane(Brep=pshift_4, Plane=c_script.a)  # -> Curves, Points
pshift_6 = ShiftPaths(Data=sec_4.Curves, Offset=-1)
rdiff_3 = RegionDifference(CurvesA=graft_3, CurvesB=pshift_6)
area_2 = Area(Geometry=rdiff_3)  # -> Area, Centroid
pl_2 = ConstructPlane(Origin=area_2.Centroid, XAxis=deplane_3.ZAxis, YAxis=deplane_3.YAxis)
tstat = TreeStatistics(Tree=pshift_5)  # -> Paths, Length, Count
tstat_2 = TreeStatistics(Tree=pshift_6)  # -> Paths, Length, Count
lng = ListLength(List=tstat.Paths)
dpath = DeconstructPath(Branch=tstat.Paths)
lng_2 = ListLength(List=tstat_2.Paths)
dpath_2 = DeconstructPath(Branch=tstat_2.Paths)
item_3 = ListItem(List=dpath, Index=0, Wrap=True)  # -> Item, Item1
item_4 = ListItem(List=dpath_2, Index=0, Wrap=True)  # -> Item, Item1
concat = Concatenate(FragmentA="Y", FragmentB=item_3.Item, FragmentC="-", FragmentD=item_3.Item1)
series = Series(Start=0, Step=Slider(200, range=0..1000), Count=lng)
pt = ConstructPoint(XCoordinate=series, YCoordinate=Slider(416, range=0..1000), ZCoordinate=0)
xy_3 = XYPlane(Origin=pt)
series_2 = Series(Start=0, Step=Slider(200, range=0..1000), Count=lng_2)
pt_2 = ConstructPoint(XCoordinate=series_2, YCoordinate=0, ZCoordinate=0)
xy_4 = XYPlane(Origin=pt_2)
concat_2 = Concatenate(FragmentA="X", FragmentB=item_4.Item, FragmentC="-", FragmentD=item_4.Item1)
lng_3 = ListLength(List=tstat.Paths)
dpath_3 = DeconstructPath(Branch=tstat.Paths)
item_5 = ListItem(List=dpath_3, Index=0, Wrap=True)  # -> Item, Item1
tag = TextTag3D(
    Location=pl_2,
    Text=concat_2,
    Size=Slider(9, range=0..100),
    Colour=ColourSwatch(SwatchColor=RGB(255, 0, 0)),
    Justification=7)
c_script_3 = CSharpScript(
    textLine=concat,
    frame=graft(xy_3),
    fontName="SLF_RHN Architect",
    textHeight=Slider(7, range=0..100),
    spacing=Slider(0, range=0..100),
    horizontalAlignment=Slider(2, range=1..3),
    verticalAlignment=Slider(2, range=1..3),
    bold=Toggle(False),
    singleStrokeFont=Toggle(False))  # -> out, a, b; inputs textLine: String, frame: Plane, fontName: String, textHeight: Double, spacing: Double, horizontalAlignment: Int32, verticalAlignment: Int32, bold: Boolean, singleStrokeFont: Boolean
# ---------- c_script_3: C# ----------
// Grasshopper Script Instance
#region Usings
using System;
using System.Linq;
using System.Collections;
using System.Collections.Generic;


using Rhino;
using Rhino.Geometry;
using Rhino.DocObjects;

using Grasshopper;
using Grasshopper.Kernel;
using Grasshopper.Kernel.Data;
using Grasshopper.Kernel.Types;
#endregion

public class Script_Instance : GH_ScriptInstance
{
    #region Notes
    /* 
      Members:
        RhinoDoc RhinoDocument
        GH_Document GrasshopperDocument
        IGH_Component Component
        int Iteration

      Methods (Virtual & overridable):
        Print(string text)
        Print(string format, params object[] args)
        Reflect(object obj)
        Reflect(object obj, string method_name)
    */
    #endregion

    private void RunScript(
		string textLine,
		Plane frame,
		string fontName,
		double textHeight,
		double spacing,
		int horizontalAlignment,
		int verticalAlignment,
		bool bold,
		bool singleStrokeFont,
		ref object a,
		ref object b)
    {
        DimensionStyle dimStyle = new DimensionStyle();
        Font thisFont = new Font(fontName);
        if(bold){
        thisFont = new Font(fontName, Font.FontWeight.Bold, Font.FontStyle.Upright, false, false);
        }
        else{
        thisFont = new Font(fontName, Font.FontWeight.Normal, Font.FontStyle.Upright, false, false);
        }
        dimStyle.Font = thisFont;
        dimStyle.TextHeight = textHeight;
        int halign = horizontalAlignment;
        int valign = verticalAlignment;

        switch(halign){
        case 1:
            dimStyle.TextHorizontalAlignment = TextHorizontalAlignment.Left;
            break;
        case 2:
            dimStyle.TextHorizontalAlignment = TextHorizontalAlignment.Center;
            break;
        case 3:
            dimStyle.TextHorizontalAlignment = TextHorizontalAlignment.Right;
            break;
        default:
            dimStyle.TextHorizontalAlignment = TextHorizontalAlignment.Center;
            break;
        }
        switch(valign){
        case 1:
            dimStyle.TextVerticalAlignment = TextVerticalAlignment.Bottom;
            break;
        case 2:
            dimStyle.TextVerticalAlignment = TextVerticalAlignment.Middle;
            break;
        case 3:
            dimStyle.TextVerticalAlignment = TextVerticalAlignment.Top;
            break;
        default:
            dimStyle.TextVerticalAlignment = TextVerticalAlignment.Middle;
            break;
        }


        TextEntity tEntity = Rhino.Geometry.TextEntity.Create(textLine, frame, dimStyle, false, textHeight, 0);
        Brep[] srf = tEntity.CreateSurfaces(dimStyle, 0, spacing);
        Curve[] crv = tEntity.CreateCurves(dimStyle, singleStrokeFont, 0, spacing);
        a = srf;
        b = crv;
    }
}
# ---------- end c_script_3 ----------
c_script_4 = CSharpScript(
    textLine=concat_2,
    frame=graft(xy_4),
    fontName="SLF_RHN Architect",
    textHeight=Slider(7, range=0..100),
    spacing=Slider(0, range=0..100),
    horizontalAlignment=Slider(2, range=1..3),
    verticalAlignment=Slider(2, range=1..3),
    bold=Toggle(False),
    singleStrokeFont=Toggle(False))  # -> out, a, b; inputs textLine: String, frame: Plane, fontName: String, textHeight: Double, spacing: Double, horizontalAlignment: Int32, verticalAlignment: Int32, bold: Boolean, singleStrokeFont: Boolean
# ---------- c_script_4: C# ----------
// Grasshopper Script Instance
#region Usings
using System;
using System.Linq;
using System.Collections;
using System.Collections.Generic;


using Rhino;
using Rhino.Geometry;
using Rhino.DocObjects;

using Grasshopper;
using Grasshopper.Kernel;
using Grasshopper.Kernel.Data;
using Grasshopper.Kernel.Types;
#endregion

public class Script_Instance : GH_ScriptInstance
{
    #region Notes
    /* 
      Members:
        RhinoDoc RhinoDocument
        GH_Document GrasshopperDocument
        IGH_Component Component
        int Iteration

      Methods (Virtual & overridable):
        Print(string text)
        Print(string format, params object[] args)
        Reflect(object obj)
        Reflect(object obj, string method_name)
    */
    #endregion

    private void RunScript(
		string textLine,
		Plane frame,
		string fontName,
		double textHeight,
		double spacing,
		int horizontalAlignment,
		int verticalAlignment,
		bool bold,
		bool singleStrokeFont,
		ref object a,
		ref object b)
    {
        //123123
        DimensionStyle dimStyle = new DimensionStyle();
        Font thisFont = new Font(fontName);
        if(bold){
        thisFont = new Font(fontName, Font.FontWeight.Bold, Font.FontStyle.Upright, false, false);
        }
        else{
        thisFont = new Font(fontName, Font.FontWeight.Normal, Font.FontStyle.Upright, false, false);
        }
        dimStyle.Font = thisFont;
        dimStyle.TextHeight = textHeight;
        int halign = horizontalAlignment;
        int valign = verticalAlignment;

        switch(halign){
        case 1:
            dimStyle.TextHorizontalAlignment = TextHorizontalAlignment.Left;
            break;
        case 2:
            dimStyle.TextHorizontalAlignment = TextHorizontalAlignment.Center;
            break;
        case 3:
            dimStyle.TextHorizontalAlignment = TextHorizontalAlignment.Right;
            break;
        default:
            dimStyle.TextHorizontalAlignment = TextHorizontalAlignment.Center;
            break;
        }
        switch(valign){
        case 1:
            dimStyle.TextVerticalAlignment = TextVerticalAlignment.Bottom;
            break;
        case 2:
            dimStyle.TextVerticalAlignment = TextVerticalAlignment.Middle;
            break;
        case 3:
            dimStyle.TextVerticalAlignment = TextVerticalAlignment.Top;
            break;
        default:
            dimStyle.TextVerticalAlignment = TextVerticalAlignment.Middle;
            break;
        }


        TextEntity tEntity = Rhino.Geometry.TextEntity.Create(textLine, frame, dimStyle, false, textHeight, 0);
        Brep[] srf = tEntity.CreateSurfaces(dimStyle, 0, spacing);
        Curve[] crv = tEntity.CreateCurves(dimStyle, singleStrokeFont, 0, spacing);
        a = srf;
        b = crv;
    }
}
# ---------- end c_script_4 ----------
tag_2 = TextTag3D(
    Location=pl,
    Text=concat,
    Size=Slider(9, range=0..100),
    Colour=ColourSwatch(SwatchColor=RGB(0, 255, 51)),
    Justification=7)
concat_3 = Concatenate(FragmentA="Y", FragmentB=item_5.Item, FragmentC="-", FragmentD=item_5.Item1)
group = Group()
lng_4 = ListLength(List=tstat.Paths)
dpath_4 = DeconstructPath(Branch=tstat.Paths)
orient = Orient(Geometry=rdiff, Source=pl, Target=graft(xy_3))  # -> Geometry, Transform
orient_2 = Orient(Geometry=rdiff_3, Source=pl_2, Target=graft(xy_4))  # -> Geometry, Transform
series_3 = Series(Start=0, Step=Slider(200, range=0..1000), Count=lng_3)
pt_3 = ConstructPoint(XCoordinate=series_3, YCoordinate=Slider(416, range=0..1000), ZCoordinate=0)
xy_5 = XYPlane(Origin=pt_3)
item_6 = ListItem(List=dpath_4, Index=0, Wrap=True)  # -> Item, Item1
tstat_3 = TreeStatistics(Tree=c_script_3.b)  # -> Paths, Length, Count
replace = ReplacePaths(Data=c_script_3.b, Search=tstat_3.Paths, Replace=tstat.Paths)
group_2 = Group(Geometry=replace)
tstat_4 = TreeStatistics(Tree=c_script_4.b)  # -> Paths, Length, Count
replace_2 = ReplacePaths(Data=c_script_4.b, Search=tstat_4.Paths, Replace=tstat_2.Paths)
group_3 = Group(Geometry=replace_2)
concat_4 = Concatenate(FragmentA="Y", FragmentB=item_6.Item, FragmentC="-", FragmentD=item_6.Item1)
series_4 = Series(Start=0, Step=Slider(200, range=0..1000), Count=lng_4)
pt_4 = ConstructPoint(XCoordinate=series_4, YCoordinate=Slider(416, range=0..1000), ZCoordinate=0)
xy_6 = XYPlane(Origin=pt_4)
c_script_5 = CSharpScript(
    textLine=concat_3,
    frame=graft(xy_5),
    fontName="SLF_RHN Architect",
    textHeight=Slider(7, range=0..100),
    spacing=Slider(0, range=0..100),
    horizontalAlignment=Slider(2, range=1..3),
    verticalAlignment=Slider(2, range=1..3),
    bold=Toggle(False),
    singleStrokeFont=Toggle(False))  # -> out, a, b; inputs textLine: String, frame: Plane, fontName: String, textHeight: Double, spacing: Double, horizontalAlignment: Int32, verticalAlignment: Int32, bold: Boolean, singleStrokeFont: Boolean; same code as c_script_3
lng_5 = ListLength(List=tstat.Paths)
dpath_5 = DeconstructPath(Branch=tstat.Paths)
c_script_6 = CSharpScript()  # -> out, a
# ---------- c_script_6: C# ----------
// Grasshopper Script Instance
#region Usings
using System;
using System.Linq;
using System.Collections;
using System.Collections.Generic;
using System.Drawing;
using System.Drawing.Text;

using Rhino;
using Rhino.Geometry;

using Grasshopper;
using Grasshopper.Kernel;
using Grasshopper.Kernel.Data;
using Grasshopper.Kernel.Types;
#endregion

public class Script_Instance : GH_ScriptInstance
{
    #region Notes
    /* 
      Members:
        RhinoDoc RhinoDocument
        GH_Document GrasshopperDocument
        IGH_Component Component
        int Iteration

      Methods (Virtual & overridable):
        Print(string text)
        Print(string format, params object[] args)
        Reflect(object obj)
        Reflect(object obj, string method_name)
    */
    #endregion

    private void RunScript(ref object a)
    {
        List<string> fontList = new List<string>();

        InstalledFontCollection installedFontCollection = new InstalledFontCollection();

        FontFamily[] fontFamilies = installedFontCollection.Families;

        foreach(FontFamily font in fontFamilies)
        {
            //asdf
        if(!String.IsNullOrEmpty(font.Name)){
            fontList.Add(font.Name);
        }
        else{}
        }

        a = fontList;
    }
}
# ---------- end c_script_6 ----------
item_7 = ListItem(List=dpath_5, Index=0, Wrap=True)  # -> Item, Item1
tag_3 = TextTag3D(
    Location=pl,
    Text=concat_3,
    Size=Slider(9, range=0..100),
    Colour=ColourSwatch(SwatchColor=RGB(0, 255, 51)),
    Justification=7)
item_8 = ListItem(List=c_script_6.a, Index=Slider(16, range=0..1000), Wrap=True)
c_script_7 = CSharpScript(
    textLine=concat_2,
    frame=graft(xy_4),
    fontName="SLF_RHN Architect",
    textHeight=Slider(7, range=0..100),
    spacing=Slider(0, range=0..100),
    horizontalAlignment=Slider(2, range=1..3),
    verticalAlignment=Slider(2, range=1..3),
    bold=Toggle(False),
    singleStrokeFont=Toggle(True))  # -> out, a, b; inputs textLine: String, frame: Plane, fontName: String, textHeight: Double, spacing: Double, horizontalAlignment: Int32, verticalAlignment: Int32, bold: Boolean, singleStrokeFont: Boolean; same code as c_script_4
concat_5 = Concatenate(FragmentA="Y", FragmentB=item_7.Item, FragmentC="-", FragmentD=item_7.Item1)
series_5 = Series(Start=0, Step=Slider(200, range=0..1000), Count=lng_5)
pt_5 = ConstructPoint(XCoordinate=series_5, YCoordinate=Slider(416, range=0..1000), ZCoordinate=0)
xy_7 = XYPlane(Origin=pt_5)
orient_3 = Orient(Geometry=rdiff, Source=pl, Target=graft(xy_5))  # -> Geometry, Transform
c_script_8 = CSharpScript(
    textLine=concat_4,
    frame=graft(xy_6),
    fontName="SLF_RHN Architect",
    textHeight=Slider(7, range=0..100),
    spacing=Slider(0, range=0..100),
    horizontalAlignment=Slider(2, range=1..3),
    verticalAlignment=Slider(2, range=1..3),
    bold=Toggle(False),
    singleStrokeFont=Toggle(False))  # -> out, a, b; inputs textLine: String, frame: Plane, fontName: String, textHeight: Double, spacing: Double, horizontalAlignment: Int32, verticalAlignment: Int32, bold: Boolean, singleStrokeFont: Boolean; same code as c_script_3
tag_4 = TextTag3D(
    Location=pl,
    Text=concat_4,
    Size=Slider(9, range=0..100),
    Colour=ColourSwatch(SwatchColor=RGB(0, 255, 51)),
    Justification=7)
panel = Panel(item_8)
tstat_5 = TreeStatistics(Tree=c_script_5.b)  # -> Paths, Length, Count
replace_3 = ReplacePaths(Data=c_script_5.b, Search=tstat_5.Paths, Replace=tstat.Paths)
group_4 = Group(Geometry=replace_3)
orient_4 = Orient(Geometry=rdiff, Source=pl, Target=graft(xy_6))  # -> Geometry, Transform
tstat_6 = TreeStatistics(Tree=c_script_7.b)  # -> Paths, Length, Count
replace_4 = ReplacePaths(Data=c_script_7.b, Search=tstat_6.Paths, Replace=tstat_2.Paths)
group_5 = Group(Geometry=replace_4)
tstat_7 = TreeStatistics(Tree=c_script_8.b)  # -> Paths, Length, Count
replace_5 = ReplacePaths(Data=c_script_8.b, Search=tstat_7.Paths, Replace=tstat.Paths)
group_6 = Group(Geometry=replace_5)
c_script_9 = CSharpScript(
    textLine=concat_5,
    frame=graft(xy_7),
    fontName="SLF_RHN Architect",
    textHeight=Slider(7, range=0..100),
    spacing=Slider(0, range=0..100),
    horizontalAlignment=Slider(2, range=1..3),
    verticalAlignment=Slider(2, range=1..3),
    bold=Toggle(False),
    singleStrokeFont=Toggle(False))  # -> out, a, b; inputs textLine: String, frame: Plane, fontName: String, textHeight: Double, spacing: Double, horizontalAlignment: Int32, verticalAlignment: Int32, bold: Boolean, singleStrokeFont: Boolean; same code as c_script_3
tag_5 = TextTag3D(
    Location=pl,
    Text=concat_5,
    Size=Slider(9, range=0..100),
    Colour=ColourSwatch(SwatchColor=RGB(0, 255, 51)),
    Justification=7)
orient_5 = Orient(Geometry=rdiff, Source=pl, Target=graft(xy_7))  # -> Geometry, Transform
c_script_10 = CSharpScript(
    textLine=concat_2,
    frame=graft(xy_4),
    fontName="SLF_RHN Architect",
    textHeight=Slider(7, range=0..100),
    spacing=Slider(0, range=0..100),
    horizontalAlignment=Slider(2, range=1..3),
    verticalAlignment=Slider(2, range=1..3),
    bold=Toggle(False),
    singleStrokeFont=Toggle(True))  # -> out, a, b; inputs textLine: String, frame: Plane, fontName: String, textHeight: Double, spacing: Double, horizontalAlignment: Int32, verticalAlignment: Int32, bold: Boolean, singleStrokeFont: Boolean; same code as c_script_4
line_3 = LineSDL(Direction=Vector(0, 0, 1), Length=1)
tstat_8 = TreeStatistics(Tree=c_script_9.b)  # -> Paths, Length, Count
replace_6 = ReplacePaths(Data=c_script_9.b, Search=tstat_8.Paths, Replace=tstat.Paths)
group_7 = Group(Geometry=replace_6)
line_4 = LineSDL(Direction=Vector(0, 0, 1), Length=1)
tstat_9 = TreeStatistics(Tree=c_script_10.b)  # -> Paths, Length, Count
replace_7 = ReplacePaths(Data=c_script_10.b, Search=tstat_9.Paths, Replace=tstat_2.Paths)
group_8 = Group(Geometry=replace_7)
line_5 = LineSDL(Direction=Vector(0, 0, 1), Length=1)
c_script_11 = CSharpScript(
    textLine=concat_2,
    frame=graft(xy_4),
    fontName="SLF_RHN Architect",
    textHeight=Slider(7, range=0..100),
    spacing=Slider(0, range=0..100),
    horizontalAlignment=Slider(2, range=1..3),
    verticalAlignment=Slider(2, range=1..3),
    bold=Toggle(False),
    singleStrokeFont=Toggle(True))  # -> out, a, b; inputs textLine: String, frame: Plane, fontName: String, textHeight: Double, spacing: Double, horizontalAlignment: Int32, verticalAlignment: Int32, bold: Boolean, singleStrokeFont: Boolean; same code as c_script_4
tstat_10 = TreeStatistics(Tree=c_script_11.b)  # -> Paths, Length, Count
replace_8 = ReplacePaths(Data=c_script_11.b, Search=tstat_10.Paths, Replace=tstat_2.Paths)
group_9 = Group(Geometry=replace_8)
